# Grasshopper definition trace-embiggen.gh (Grasshopper 0.9.76)

number_slider = Slider(1.8, range=0..15)
crv = Curve(flatten([<curve referenced from the Rhino model> x2589]))
multiplication = Multiplication(A=number_slider, B=-1)
end = EndPoints(Curve=crv)  # -> Start, End
offset = Offset(Curve=crv, Distance=number_slider, Plane=PlaneXY(0, 0, 0), Corners=2)
offset_2 = Offset(Curve=crv, Distance=multiplication, Plane=PlaneXY(0, 0, 0), Corners=2)
end_2 = EndPoints(Curve=offset)  # -> Start, End
circle = CircleCNR(Center=[end.Start, end.End], Normal=Vector(0, 0, 1), Radius=number_slider)
end_3 = EndPoints(Curve=offset_2)  # -> Start, End
ln = Line(StartPoint=end_2.End, EndPoint=end_3.End)
ln_2 = Line(StartPoint=end_2.Start, EndPoint=end_3.Start)
join = JoinCurves(Curves=[ln_2, ln, offset, offset_2], Preserve=False)
runion = RegionUnion(Curves=flatten([join, circle]))  # disabled
